# Grasshopper definition Example File.gh (Grasshopper 1.0.7)
# plug-ins: PoliBrick

multi_slider_panel = MultiSliderPanel(
    R0_Cur=0.6,
    R0_Max=3,
    R0_Min=0,
    R1_Cur=2.730583191,
    R1_Max=3,
    R1_Min=0,
    R2_Cur=0.1135392711,
    R2_Max=1,
    R2_Min=0,
    R3_Cur=0.03194469959,
    R3_Max=1,
    R3_Min=0)
multi_slider_panel_2 = MultiSliderPanel(R0_Cur=31.59139574, R0_Max=90, R0_Min=0, R1_Cur=0, R1_Max=90, R1_Min=0, R2_Cur=0.05, R2_Max=90, R2_Min=0)
multi_slider_panel_3 = MultiSliderPanel(
    R0_Cur=0.6,
    R0_Max=3,
    R0_Min=0,
    R1_Cur=1.498343021,
    R1_Max=3,
    R1_Min=0,
    R2_Cur=0.1135392711,
    R2_Max=1,
    R2_Min=0,
    R3_Cur=0.03194469959,
    R3_Max=1,
    R3_Min=0)
multi_slider_panel_4 = MultiSliderPanel(R0_Cur=0, R0_Max=90, R0_Min=0, R1_Cur=14.60653245, R1_Max=90, R1_Min=0, R2_Cur=0.05, R2_Max=90, R2_Min=0)
surface = Surface(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)
curve = Curve(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)
_2_parallelcurve = _2ParallelCurve(
    Surface=surface,
    Curve=curve,
    Distance=Slider(2.25, range=0.01..20),
    Count=Slider(20, range=0..100),
    Accuracy=Slider(1, range=0..1),
    Mode=Slider(3, range=0..10),
    ExtendCurves=True,
    FilterIntersections=True,
    HasData=True,
    State_Complete=True,
    State_K=1,
    State_MaxIter=0,
    State_Mode=3)  # -> Curves, OrderedCurves, RefinedCurves
_3_brickdata = _3BrickData(
    Name="A",
    UVWM=multi_slider_panel,
    ΑΒΘ=multi_slider_panel_2,
    RotationPattern="T",
    Color=ColourSwatch(SwatchColor=RGB(255, 165, 0)))
_3_brickdata_2 = _3BrickData(
    Name="B",
    UVWM=multi_slider_panel_3,
    ΑΒΘ=multi_slider_panel_4,
    RotationPattern="TF",
    Color=ColourSwatch(SwatchColor=RGB(46, 101, 124)))
_4_patterngenerator = _4PatternGenerator(Pattern="ABB", Repeat=1, Plus="Empty!", InfiniteMode=True)
_4_patterngenerator_2 = _4PatternGenerator(Pattern="ABB", Repeat=1, Plus="Empty!", InfiniteMode=True)
entwine = Entwine(Branch00=_3_brickdata, Branch01=_3_brickdata_2, FlattenInputs=True)  # -> simplify(Result)
surface_2 = Surface(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)
_2_propagating_quad_mesh = _2PropagatingQuadMesh(
    MeshingCurves=_2_parallelcurve.OrderedCurves,
    Patterns=_4_patterngenerator_2,
    Length=Slider(0.6, range=0.01..20),
    Thickness=Slider(0.05, range=0.01..20),
    AngleTolerance=Slider(1.97, range=0.01..20),
    AspectRatio=Slider(0.01, range=0.01..20),
    MinimumCornerAngle=Slider(67, range=0..90),
    Surface=surface,
    FlipNormals=True)  # -> HomogenizedMesh, DiscreteMeshBlocks
_1_solver = _1Solver(Curves=_2_parallelcurve.OrderedCurves, Pattern=_4_patterngenerator, Data=entwine, Surface=surface_2, FlipNormals=False)  # -> BricksOrdered, BricksType, FacePlanes
mesh = Mesh(_2_propagating_quad_mesh.DiscreteMeshBlocks)
create_material = CreateMaterial(
    Diffuse=ColourSwatch(SwatchColor=RGB(255, 165, 0)),
    Specular=RGB(255, 255, 255),
    Emission=ColourSwatch(SwatchColor=RGB(195, 139, 124)),
    Transparency=0,
    Shine=0)
mesh_2 = Mesh(_2_propagating_quad_mesh.HomogenizedMesh)
_6_cullintersection = _6CullIntersection(Bricks=_1_solver.BricksOrdered, FacePlanes=_1_solver.FacePlanes, FrontPattern="%", TopPattern="%", Offset=0)
mesh_edges = MeshEdges(Mesh=mesh_2)  # -> NakedEdges, InteriorEdges, NonManifoldEdges
custom_preview = CustomPreview(Geometry=mesh_2, Material=create_material)
_5_cutter = _5Cutter(Surface=surface_2, Bricks=_6_cullintersection, EdgeIndices="1", SearchSpheres=10)  # -> simplify(RefinedBlocks)
